# Grasshopper definition virtualAgent2_Gal.gh (Grasshopper 1.0.4)
# plug-ins: Python Interpreter

number_slider = Slider(10, range=0..100)
mesh_box = MeshBox(
    Base={Plane=PlaneXY(0, 0, 0), X=Domain(-10, 10), Y=Domain(-10, 10), Z=Domain(-10, 10)},
    XCount=number_slider,
    YCount=number_slider,
    ZCount=Slider(4, range=0..10))
vec = VectorXYZ(XComponent=Slider(0, range=0..50), YComponent=Slider(0, range=0..50), ZComponent=Slider(0, range=0..50))  # -> Vector, Length
dom = ConstructDomain(DomainStart=Slider(0.301, range=0..1), DomainEnd=Slider(0.352, range=0..1))
msphere = MeshSphere(
    Base=PlaneXY(0, 0, 0),
    Radius=Slider(9.312, range=0..12),
    UCount=Slider(60, range=0..100),
    VCount=Slider(60, range=0..100))
move = Move(Geometry=msphere, Motion=vec.Vector)  # -> Geometry, Transform
mesh = Mesh(move.Geometry)
demesh = DeconstructMesh(Mesh=mesh)  # -> Vertices, Faces, Colours, Normals
lng = ListLength(List=demesh.Vertices)
random = Random(Range=dom, Number=lng, Seed=Slider(19.474, range=0..100))
data = Data(demesh.Vertices)
data_2 = Data(demesh.Vertices)
panel = Panel(data_2)
panel_2 = Panel(data)
list_item = ListItem(List=data, Index=0, Wrap=True)
list_length = ListLength()
image = ImageSampler(
    data_2,
    FilePath="/Users/galzemach/School/HCI/final_project/HCI-final-project/grasshopper/images/slices2_02.bmp",
    Filter="Value",
    Interpolate=False,
    Umax=100,
    Umin=0,
    Vmax=100,
    Vmin=0,
    Wrap=1)  # disabled
image_2 = ImageSampler(
    data_2,
    FilePath="/Users/galzemach/School/HCI/final_project/HCI-final-project/grasshopper/images/black.bmp",
    Filter="Value",
    Interpolate=True,
    Umax=1000,
    Umin=1,
    Vmax=1000,
    Vmin=1,
    Wrap=1)
number_slider_2 = Slider(0.25, range=0..1)
python_script = PythonScript(X=list_item)  # -> Out, A
deconstruct_vector = DeconstructVector()  # -> XComponent, YComponent, ZComponent
evaluate = Evaluate()
merge = Merge(Data1=image_2)
entwine = Entwine(Branch00=image_2, Branch01=image, FlattenInputs=True)
tstat = TreeStatistics(Tree=entwine)  # -> Paths, Length, Count
addition = Addition(A=merge, B=random)
panel_3 = Panel(merge)
viewer = ParamViewer(entwine)
list_length_2 = ListLength(List=merge)
cset = CreateSet(List=tstat.Length)  # -> Set, Map
multiplication = Multiplication(A=addition, B=Slider(40.951, range=0..100))
moveaway = MoveAwayFrom(Geometry=demesh.Vertices, Emitter=vec.Vector, Distance=multiplication)  # -> Geometry, Transform
series = Series(Start=0, Step=1, Count=cset.Set)  # -> graft(Series)
item = TreeItem(Tree=entwine, Path=tstat.Paths, Index=series, Wrap=True)
conmesh = ConstructMesh(Vertices=moveaway.Geometry, Faces=demesh.Faces)
panel_4 = Panel(item)
avr = Average(Input=item)
rotate = Rotate(Geometry=conmesh, Angle=Slider(20.708, range=0..50), Plane=PlaneXY(0, 0, 0))  # -> Geometry, Transform
panel_5 = Panel(avr)

colour_picker = ColourPicker(PickedColour=RGB(47, 44, 87))
colour_picker_2 = ColourPicker(PickedColour=RGB(0, 0, 0))
colour_picker_3 = ColourPicker(PickedColour=RGB(45, 125, 65))
create_material = CreateMaterial(
    Diffuse=colour_picker,
    Specular=colour_picker_2,
    Emission=colour_picker_3,
    Transparency=Slider(0, range=0..1),
    Shine=Slider(68, range=0..100))

shader = Shader(create_material)
custom_preview = CustomPreview(Geometry=rotate.Geometry, Shader=shader)
